vi "Generate Waveform (Multi-Array).gvi"   [LabVIEW NXG 4.0.0]
inputs:
  "number of samples": u32 = 300000
  "sample rate": f64 = 10000000
  "tone frequency": f64 = 130000
  "amplitude": f64 = 1
outputs:
  "Sample Number": u32
  "i": i16[]
  "q": i16[]
  "waveform": waveform<f64>[]
  "error out": error
  "Fs": f64
uses:
  Host SubVIs::GenLTEFrame1TxAnt.mli::GetLTEFrame1TxAnt
  NI::G Core::File IO (General)::Write Delimited Spreadsheet (Waveform Array).gvi
  Host SubVIs::GenSineTone.mli::GenSineTone
  NI::Analysis::Generation::Sine Waveform.gvi
diagram:
  call "GetLTEFrame1TxAnt"() -> (ComplexSamples=w1, Fs=w2)
  Array Size(array=w1) -> (size(s)=w3)
  $"Sample Number" <- w3
  $Fs <- w2
  Complex To Real And Imaginary(x + iy=w1) -> (x=w4, y=w5)
  Reciprocal(x=w2) -> w6
  Build Waveform Node(Y=w4, dt=w6) -> (output waveform=w7)
  Build Waveform Node(Y=w5, dt=w6) -> (output waveform=w8)
  Build Array(w7, w8) -> w9
  call "Write Delimited Spreadsheet (Waveform Array).gvi"(delimiter=";", file=path "C:\\Users\\ge69mog\\Documents\\WaveformLTEFrame.csv", waveforms=w9)
  $waveform <- w9
  call "GenSineTone"(Fs=$"sample rate", NoOfSamples=$"number of samples", Amplitude=$amplitude)
  Property Node(instance in=w7) -> ("Y"=w10)
  Multiply(w10, 32767) -> w11
  To Signed 16 Bit Integer(number=w11) -> w12
  $i <- w12
  Property Node(instance in=w8) -> ("Y"=w13)
  Multiply(w13, 32767) -> w14
  To Signed 16 Bit Integer(number=w14) -> w15
  $q <- w15
  call "Sine Waveform.gvi"(sample rate=$"sample rate", samples=$"number of samples", amplitude=$amplitude, frequency=$"tone frequency", phase in=90) -> (error out=w16)
  call "Sine Waveform.gvi"(sample rate=$"sample rate", samples=$"number of samples", amplitude=$amplitude, frequency=$"tone frequency", phase in=0) -> (error out=w17)
  Merge Errors(w16, w17) -> (error out=w18)
  $"error out" <- w18
